# Grasshopper definition qlist-to-score-osc.gh (Grasshopper 1.0.7)
# plug-ins: Pufferfish, Squid (ShapeDiver Edition), gHowl, HDTTreeUtils, EleFront

number_slider = Slider(31, range=0..100)
curve = Curve(<curve referenced from the Rhino model>)
number_slider_2 = Slider(999, range=0..1000)
divide_curve = DivideCurve(Curve=curve, Count=Slider(21, range=0..100), Kinks=False)  # -> Points, Tangents, Parameters
normalized_time = GetString(AtLeast=1, AtMost=1, Prompt="Normalized Time")
number_slider_3 = Slider(0, range=0..100)
list_item = ListItem(List=divide_curve.Points, Index="15", Wrap=True)
udp_receiver = UDPReceiver(Port=Slider(6002, range=0..10000), Pattern=number_slider_2)  # -> Info, Data
udp_receiver_2 = UDPReceiver(Port=Slider(6001, range=0..10000), Pattern=number_slider_2)  # -> Info, Data
point = Point(list_item)
cull_index = CullIndex(List=udp_receiver.Data, Indices=number_slider_3, Wrap=True)
cull_index_2 = CullIndex(List=udp_receiver_2.Data, Indices=number_slider_3, Wrap=True)
length = GetNumber(
    Slider(230, range=0..1000),
    AtLeast=1,
    AtMost=1,
    Maximum=1.797693135e+308,
    Minimum=-1.797693135e+308,
    Prompt="Length of X Axis")
negative = Negative(Value=Slider(2, range=0..100))
unit_x = UnitX(Factor=negative)
number_slider_4 = Slider(0.5, range=0..1)
xy_plane = XYPlane(Origin=point)
unit_x_2 = UnitX(Factor=1)
panel = Panel(cull_index)
panel_2 = Panel(cull_index_2)
paragraph = Paragraph(HAlign=Slider(2, range=0..10), VAlign=Slider(1, range=0..1), RightLeft=False)
move = Move(Geometry=xy_plane, Motion=unit_x)  # -> Geometry, Transform
negative_2 = Negative(Value=number_slider_4)
construct_domain = ConstructDomain(DomainStart="500", DomainEnd="10000")
xy_plane_2 = XYPlane(Origin=point)
construct_domain_2 = ConstructDomain(DomainStart=negative_2, DomainEnd=number_slider_4)
bounds = Bounds(Numbers=panel_2)
list_indices = ListIndices(List=panel)
font = Font(Family="HK Grotesk", Size=Slider(2, range=0..100), Bold=False, Italic=False, Underline=False)
list_length = ListLength(List=panel)
line_sdl = LineSDL(Start=xy_plane_2, Direction=unit_x_2, Length=length)
remap_numbers = RemapNumbers(Value=panel_2, Source=bounds, Target=construct_domain_2)  # -> simplify(graft(Mapped)), Clipped
addition = Addition(A=list_indices, B=1)
text_curves = TextCurves(Plane=move.Geometry, Text="Feedback Q Factor", Font=font, Paragraph=paragraph)
assignpaths = AssignPaths(InputData=flatten(Slider(1, range=0..1)), PathsToAssign=flatten(list_length))
split_list = SplitList(List=panel, Index=addition)  # -> ListA, ListB
mass_addition = MassAddition(Input=simplify(split_list.ListA))  # -> Result, PartialResults
panel_3 = Panel(mass_addition.Result)
number_slider_5 = Slider(100, range=0..100)
evaluate_curve = EvaluateCurve(Curve=reparameterize(line_sdl), Parameter=[mass_addition.Result, assignpaths])  # -> Point, Tangent, Angle
multiplication = Multiplication(A=remap_numbers.Mapped, B="6")
unit_y = UnitY(Factor=multiplication)
move_2 = Move(Geometry=evaluate_curve.Point, Motion=unit_y)  # -> Geometry, Transform
point_2 = Point(flatten(move_2.Geometry))
deconstruct = Deconstruct(Point=point_2)  # -> XComponent, YComponent, ZComponent
shift_list = ShiftList(List=point_2, Shift=1, Wrap=True)
deconstruct_2 = Deconstruct(Point=shift_list)  # -> XComponent, YComponent, ZComponent
construct_point = ConstructPoint(XCoordinate=deconstruct_2.XComponent, YCoordinate=deconstruct.YComponent, ZCoordinate=deconstruct_2.ZComponent)
cull_index_3 = CullIndex(List=construct_point, Indices=-1, Wrap=True)
weave = Weave(Pattern=[0, 1], Stream0=point_2, Stream1=cull_index_3, NullGaps=False)
polyline = PolyLine(Vertices=flatten(move_2.Geometry), Closed=False)
geometry = Geometry([text_curves, polyline])
bake_objects = BakeObjects(Geometry=geometry, Bake=False)
context_bake = ContextBake(Geometry=[text_curves, polyline])
