# Grasshopper definition qlist-to-score.gh (Grasshopper 1.0.7)
# plug-ins: Pufferfish, Squid (ShapeDiver Edition)

normalized_time = GetString(AtLeast=1, AtMost=1, Prompt="Normalized Time")
values = GetString(AtLeast=1, AtMost=1, Prompt="Values")
text_split = TextSplit(Text=normalized_time, Separators=" ")
length = GetNumber(AtLeast=1, AtMost=1, Maximum=1.797693135e+308, Minimum=-1.797693135e+308, Prompt="Length of X Axis")
get_point = GetPoint(AtLeast=1, AtMost=1, Prompt="Starting Point", Realtime=True)
get_string = GetString(AtLeast=1, AtMost=1)
get_number = GetNumber(AtLeast=1, AtMost=1, Maximum=1.797693135e+308, Minimum=-1.797693135e+308, Prompt="Max. Length for Y Axis")
negative = Negative(Value=Slider(100, range=0..100))
number_slider = Slider(1, range=0..1)
text_split_2 = TextSplit(Text=values, Separators=" ")
unit_x = UnitX(Factor=negative)
number = Number(text_split)
number_slider_2 = Slider(0.5, range=0..1)
xy_plane = XYPlane(Origin=get_point)
number_2 = Number(text_split_2)
unit_x_2 = UnitX(Factor=1)
panel = Panel(number)
panel_2 = Panel(number_2)
paragraph = Paragraph(HAlign=number_slider, VAlign=number_slider, RightLeft=False)
move = Move(Geometry=xy_plane, Motion=unit_x)  # -> Geometry, Transform
negative_2 = Negative(Value=number_slider_2)
xy_plane_2 = XYPlane(Origin=get_point)
construct_domain = ConstructDomain(DomainStart=negative_2, DomainEnd=number_slider_2)
bounds = Bounds(Numbers=panel_2)
list_indices = ListIndices(List=panel)
font = Font(Family="HK Grotesk", Size=Slider(1, range=0..100), Bold=False, Italic=False, Underline=False)
line_sdl = LineSDL(Start=xy_plane_2, Direction=unit_x_2, Length=length)
remap_numbers = RemapNumbers(Value=panel_2, Source=bounds, Target=construct_domain)  # -> graft(Mapped), Clipped
addition = Addition(A=list_indices, B=1)
text_curves = TextCurves(Plane=move.Geometry, Text=get_string, Font=font, Paragraph=paragraph)
split_list = SplitList(List=panel, Index=addition)  # -> ListA, ListB
mass_addition = MassAddition(Input=split_list.ListA)  # -> Result, PartialResults
number_slider_3 = Slider(100, range=0..100)
evaluate_curve = EvaluateCurve(Curve=reparameterize(line_sdl), Parameter=mass_addition.Result)  # -> Point, Tangent, Angle
multiplication = Multiplication(A=remap_numbers.Mapped, B=get_number)
unit_y = UnitY(Factor=multiplication)
move_2 = Move(Geometry=evaluate_curve.Point, Motion=unit_y)  # -> Geometry, Transform
polyline = PolyLine(Vertices=flatten(move_2.Geometry), Closed=False)
context_bake = ContextBake(Geometry=[text_curves, polyline])
